# Grasshopper definition MetaMAP_advanced.ghx (Grasshopper 1.0.8)
# plug-ins: MetaMAP

number_slider = Slider(350, range=0..500)
metafetch = MetaFETCH(ShowMap=Button())  # -> Latitude, Longitude
metaupdate = MetaUPDATE(Update=Toggle(True))  # -> Status, YourVersion
metaterrain = MetaTERRAIN(
    Latitude=metafetch.Latitude,
    Longitude=metafetch.Longitude,
    Radius=number_slider,
    GridResolution="5",
    ShowPoints=Toggle(True))  # -> TerrainMesh, ElevationPoints, ElevationValues, Status
panel = Panel(metaupdate.Status)
metabuildingadvanced = MetaBuildingAdvanced(
    Latitude=metafetch.Latitude,
    Longitude=metafetch.Longitude,
    Radius=expr("x-100", number_slider),
    Run=Toggle(True),
    TerrainMesh=metaterrain.TerrainMesh)  # -> Buildings, DebugLog
panel_2 = Panel(metabuildingadvanced.DebugLog)
custom_preview = CustomPreview(Geometry=metabuildingadvanced.Buildings, Material=ColourSwatch(SwatchColor=RGB(255, 255, 255)))
custom_preview_2 = CustomPreview(Geometry=metaterrain.TerrainMesh, Material=ColourSwatch(SwatchColor=RGB(133, 133, 133)))
