# Grasshopper definition MetaMAP_basic.ghx (Grasshopper 1.0.8)
# plug-ins: MetaMAP

number_slider = Slider(500, range=0..1000)
metafetch = MetaFETCH(ShowMap=Button())  # -> Latitude, Longitude
metaupdate = MetaUPDATE(Update=Toggle(False))  # -> Status, YourVersion
metaterrain = MetaTERRAIN(
    Latitude=metafetch.Latitude,
    Longitude=metafetch.Longitude,
    Radius=number_slider,
    GridResolution="10",
    ShowPoints=Toggle(True))  # -> TerrainMesh, ElevationPoints, ElevationValues, Status
panel = Panel(metaupdate.Status)
metabuilding = MetaBuilding(
    Latitude=metafetch.Latitude,
    Longitude=metafetch.Longitude,
    Radius=expr("x-100", number_slider),
    TerrainMesh=metaterrain.TerrainMesh)  # -> BuildingMeshes, BuildingHeights, Status
surface_from_points = SurfaceFromPoints(Points=metaterrain.ElevationPoints, UCount="10", Interpolate=True)

# ---- group: Terrain as Brep
brep = Brep(surface_from_points)

# ----
deconstruct_brep = DeconstructBrep(Brep=surface_from_points)  # -> Faces, Edges, Vertices
project = Project(Geometry=surface_from_points, Plane=PlaneXY(0, 0, 0))  # -> Geometry, Transform
join_curves = JoinCurves(Curves=deconstruct_brep.Edges, Preserve=False)
ruled_surface = RuledSurface(CurveA=project.Geometry, CurveB=join_curves)
merge = Merge(Data1=surface_from_points, Data2=ruled_surface, Data3=project.Geometry)

# ---- group: Terrain as Closed Polysurface
brep_join = BrepJoin(Breps=flatten(merge))  # -> Breps, Closed

# ---- group: Building subtracted from terrain
solid_difference = SolidDifference(BrepsA=metabuilding.BuildingMeshes, BrepsB=brep_join.Breps)

# ----
custom_preview = CustomPreview(Geometry=solid_difference, Material=ColourSwatch(SwatchColor=RGB(209, 209, 209)))
custom_preview_2 = CustomPreview(Geometry=brep_join.Breps, Material=ColourSwatch(SwatchColor=RGB(51, 51, 51)))
