# Grasshopper definition MetaMAP_basic.ghx (Grasshopper 1.0.8)
# plug-ins: MetaMAP

number_slider = Slider(300, range=0..1000)
metafetch = MetaFETCH(ShowMap=Button())  # -> Latitude, Longitude
metaupdate = MetaUPDATE(Update=Toggle(True))  # -> Status, YourVersion
metaterrain = MetaTERRAIN(Latitude=metafetch.Latitude, Longitude=metafetch.Longitude, Radius=number_slider)  # -> TerrainMesh, ElevationPoints, ElevationValues, Status
panel = Panel(metaupdate.Status)
metabuilding = MetaBuilding(
    Latitude=metafetch.Latitude,
    Longitude=metafetch.Longitude,
    Radius=expr("x-100", number_slider),
    TerrainMesh=metaterrain.TerrainMesh)  # -> BuildingMeshes, BuildingHeights, Status
